# Dynamo graph EtiquetarAutomaticamente.dyn (Dynamo 2.19.3.6394)

string = StringInput("Name_Apartment_Typology")
categories = Categories()  # nothing selected
all_elements_of_category = ElementsOfCategory(Category=categories)
string_2 = StringInput("EBB_Chapter_II")
string_3 = StringInput("Apartment Layout")
family_types = FamilyTypes("Area_Name_Apartment:Name_Apartment_Typology")
python_script = Python(IN[0]=all_elements_of_category, IN[1]=string_2, IN[2]=string_3, IN[3]=family_types)  # CPython3
# ---------- python_script.python (88 lines) ----------
import clr                                                                                   # 1
clr.AddReference('RevitAPI')                                                                 # 2
clr.AddReference('RevitServices')                                                            # 3
clr.AddReference('RevitNodes')                                                               # 4
import Revit                                                                                 # 5
clr.ImportExtensions(Revit.Elements)                                                         # 6

from Autodesk.Revit.DB import (FilteredElementCollector, View, IndependentTag,               # 7
                               TagMode, TagOrientation, StorageType, BuiltInCategory,         # 8
                               Reference, XYZ)                                               # 9
from RevitServices.Persistence import DocumentManager                                        # 10
from RevitServices.Transactions import TransactionManager                                    # 11

# Entradas de Dynamo                                                                          #
views_wrapped  = IN[0]    # lista de vistas (wrapped)                                        # 12
param_name     = IN[1]    # e.g. "EBB_Chapter_II"                                             # 13
filter_value   = IN[2]    # e.g. "apartment Layout"                                         # 14
symbol_wrapped = IN[3]    # FamilyType de Room Tag (Name_Apartment_Typology)                  # 15

doc = DocumentManager.Instance.CurrentDBDocument                                             # 16

# 1) Unwrap o fallback a collector                                                            #
if views_wrapped is not None:                                                                 # 17
    try:                                                                                      # 18
        views_api = UnwrapElement(views_wrapped)                                             # 19
    except:                                                                                   # 20
        views_api = list(views_wrapped)                                                      # 21
else:                                                                                         # 22
    views_api = FilteredElementCollector(doc)                                                \
        .OfClass(View)                                                                       \
        .WhereElementIsNotElementType()                                                      \
        .ToElements()                                                                        # 23

# 2) Unwrap del símbolo de etiqueta                                                            #
try:                                                                                          # 24
    symbol = UnwrapElement(symbol_wrapped)                                                   # 25
except:                                                                                       # 26
    symbol = symbol_wrapped                                                                  # 27

# 3) Filtrar vistas por parámetro                                                               #
filtered = []                                                                                 # 28
for v in views_api:                                                                           # 29
    if getattr(v, 'IsTemplate', False):                                                       # 30
        continue                                                                              # 31
    p = v.LookupParameter(param_name)                                                         # 32
    if p and p.StorageType == StorageType.String and p.AsString() == filter_value:           # 33
        filtered.append(v)                                                                    # 34

# 4) Activar el tipo de etiqueta si hace falta                                                 #
if not symbol.IsActive:                                                                       # 35
    symbol.Activate()                                                                         # 36
    doc.Regenerate()                                                                          # 37

# 5) Crear etiquetas en cada viewport                                                           #
TransactionManager.Instance.EnsureInTransaction(doc)                                           # 38
for v in filtered:                                                                            # 39
    vps = FilteredElementCollector(doc)                                                       \
        .OfCategory(BuiltInCategory.OST_Viewports)                                            \
        .WhereElementIsNotElementType()                                                       \
        .ToElements()                                                                         # 40
    for vp in vps:                                                                             # 41
        if vp.ViewId == v.Id:                                                                  # 42
            loc = vp.Location                                                                  # 43
            if hasattr(loc, 'Point'):                                                         # 44
                pt = loc.Point                                                                 # 45
            elif hasattr(loc, 'Curve'):                                                       # 46
                pt = loc.Curve.Evaluate(0.5, True)                                            # 47
            else:                                                                             # 48
                bb = v.get_BoundingBox(None)                                                  # 49
                if bb is not None:                                                            # 50
                    min_pt = bb.Min                                                           # 51
                    max_pt = bb.Max                                                           # 52
                    pt = XYZ((min_pt.X + max_pt.X)/2.0,                                        # 53
                             (min_pt.Y + max_pt.Y)/2.0,                                        # 54
                             (min_pt.Z + max_pt.Z)/2.0)                                        # 55
                else:                                                                         # 56
                    pt = XYZ(0, 0, 0)                                                         # 57
            ref = Reference(vp)                                                                # 58
            tag = IndependentTag.Create(                                                      # 59
                doc, vp.SheetId, ref, False,                                                  # 60
                TagMode.TM_ADDBY_CATEGORY, TagOrientation.Horizontal, pt                       # 61
            )                                                                                  # 62
            tag.ChangeTypeId(symbol.Id)                                                        # 63
            break                                                                              # 64
TransactionManager.Instance.TransactionTaskDone()                                             # 65

# 6) Devolver resultados                                                                       #
OUT = filtered                                                                               # 66
# ----------------------------------------
